# Grasshopper definition 1007.gh (Grasshopper 1.0.7)
# plug-ins: BarkBeetle

geodesics_in_u = Curve([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])
srf = Surface(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)
geodesics_in_v = Curve([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])
ccx = CurveCurve(CurveA=graft(geodesics_in_v), CurveB=geodesics_in_u)  # -> simplify(Points), ParamsA, ParamsB
trim = TrimTree(Tree=ccx.Points, Depth=1)
flip = FlipMatrix(Data=trim)
spiral_skeleton = SpiralSkeleton(Surface=srf, PointsTree=trim, StripWidth=Slider(7, range=0..10))  # -> RefinedGeometry, SkeletonPoints
unpack_geo = UnpackGeometryPackage(GeometryPackage=spiral_skeleton.RefinedGeometry)  # -> OrganizedPointTree, ExtendedSurface, SkeletonPoints, UVCurves, UVVectors
item = ListItem(List=unpack_geo.OrganizedPointTree, Index=0, Wrap=True)  # -> flatten(Item)
item_2 = ListItem(List=unpack_geo.UVVectors, Index=0, Wrap=True)
item_3 = ListItem(List=unpack_geo.UVVectors, Index="1", Wrap=True)
trim_2 = TrimTree(Tree=item_3, Depth=1)
trim_3 = TrimTree(Tree=item_2, Depth=1)
item_4 = ListItem(List=item, Index=0, Wrap=True)
vdis = VectorDisplay(Anchor=unpack_geo.OrganizedPointTree, Vector=trim_2)
vdis_2 = VectorDisplay(Anchor=unpack_geo.OrganizedPointTree, Vector=trim_3)
